# Grasshopper definition 1_cubo.gh (Grasshopper 1.0.7)

xz = XZPlane(Origin=Point(0, 0, 0))
pt = Point(<point referenced from the Rhino model>)
recgrid = Rectangular(
    Plane=xz,
    SizeX=Slider(75, range=0..100),
    SizeY=Slider(60, range=0..100),
    ExtentX=Slider(5, range=0..10),
    ExtentY=Slider(4, range=0..10))  # -> Cells, Points
dist = Distance(PointA=pt, PointB=recgrid.Points)
number_slider = Slider(25, range=0..100)
bnd = Bounds(Numbers=dist)
ln = Line(StartPoint=recgrid.Points, EndPoint=pt)
box = CenterBox(Base=recgrid.Points, X=number_slider, Y=number_slider, Z=number_slider)
dom = ConstructDomain(DomainStart=0, DomainEnd=Slider(360, range=0..1000))
xy = XYPlane(Origin=recgrid.Points)
remap = RemapNumbers(Value=dist, Source=bnd, Target=dom)  # -> Mapped, Clipped
rotate = Rotate(Geometry=box, Angle=degrees(Slider(0, range=0..100)), Plane=xy)  # -> Geometry, Transform
