# Grasshopper definition 1_cubo.gh (Grasshopper 1.0.7)
# plug-ins: Firefly

xz = XZPlane(Origin=Point(0, 0, 0))
ports_available = COMPortsAvailable()
crv = Curve(<curve referenced from the Rhino model>)
panel = Panel(ports_available)
timer = Timer(Interval=500, TimerInterval=500, Target=read)  # disabled
eval = EvaluateCurve(Curve=reparameterize(crv), Parameter=Slider(0, range=0..1))  # -> Point, Tangent, Angle
read = SerialReadGeneric(StartReadingValues=Toggle(False), PortNumber="3")  # -> SerialOutput, StatusMessage
recgrid = Rectangular(
    Plane=xz,
    SizeX=Slider(75, range=0..100),
    SizeY=Slider(60, range=0..100),
    ExtentX=Slider(5, range=0..10),
    ExtentY=Slider(4, range=0..10))  # -> Cells, flatten(Points)
open_port = OpenClosePort(OpenClosePort=Toggle(False), PortNumber=ports_available, BaudRate="9600")
dist = Distance(PointA=eval.Point, PointB=recgrid.Points)
number_slider = Slider(25, range=0..100)
panel_2 = Panel(read.SerialOutput)
panel_3 = Panel(read.StatusMessage)
bnd = Bounds(Numbers=dist)
ln = Line(StartPoint=recgrid.Points, EndPoint=eval.Point)  # disabled
panel_4 = Panel(open_port)
box = CenterBox(Base=recgrid.Points, X=number_slider, Y=number_slider, Z=number_slider)
number_slider_2 = Slider(100, range=0..100)
dom = ConstructDomain(DomainStart=0, DomainEnd=Slider(90, range=0..360))
xy = XYPlane(Origin=recgrid.Points)
remap = RemapNumbers(Value=dist, Source=bnd, Target=dom)  # -> Mapped, Clipped
min = Minimum(A=read.SerialOutput, B=number_slider_2)
rotate = Rotate(Geometry=box, Angle=degrees(remap.Mapped), Plane=xy)  # -> Geometry, Transform
panel_5 = Panel(min)
dom_2 = ConstructDomain(DomainStart=0, DomainEnd=number_slider_2)
remap_2 = RemapNumbers(Value=min, Source=dom_2, Target=Domain(0, 1))  # -> Mapped, Clipped
xz_2 = XZPlane(Origin=Point(0, 0, 0))
crv_2 = Curve(<curve referenced from the Rhino model>)
eval_2 = EvaluateCurve(Curve=reparameterize(crv_2), Parameter=remap_2.Mapped)  # -> Point, Tangent, Angle
recgrid_2 = Rectangular(
    Plane=xz_2,
    SizeX=Slider(75, range=0..100),
    SizeY=Slider(60, range=0..100),
    ExtentX=Slider(5, range=0..10),
    ExtentY=Slider(4, range=0..10))  # -> Cells, flatten(Points)
dist_2 = Distance(PointA=eval_2.Point, PointB=recgrid_2.Points)
number_slider_3 = Slider(25, range=0..100)
bnd_2 = Bounds(Numbers=dist_2)
ln_2 = Line(StartPoint=recgrid_2.Points, EndPoint=eval_2.Point)  # disabled
box_2 = CenterBox(Base=recgrid_2.Points, X=number_slider_3, Y=number_slider_3, Z=number_slider_3)
dom_3 = ConstructDomain(DomainStart=0, DomainEnd=Slider(90, range=0..360))
xy_2 = XYPlane(Origin=recgrid_2.Points)
remap_3 = RemapNumbers(Value=dist_2, Source=bnd_2, Target=dom_3)  # -> Mapped, Clipped
rotate_2 = Rotate(Geometry=box_2, Angle=degrees(remap_3.Mapped), Plane=xy_2)  # -> Geometry, Transform
