# Grasshopper definition 2_vaso.gh (Grasshopper 1.0.7)
# plug-ins: Firefly

ports_available = COMPortsAvailable()
crv = Curve(<curve referenced from the Rhino model>)
panel = Panel(ports_available)
timer = Timer(Interval=500, TimerInterval=500, Target=read)  # disabled
random = Random(Range=Domain(0, 1), Number=Slider(30, range=0..100), Seed=Slider(60, range=0..100))
read = SerialReadGeneric(StartReadingValues=Toggle(False), PortNumber="3")  # -> SerialOutput, StatusMessage
open_port = OpenClosePort(OpenClosePort=Toggle(False), PortNumber=ports_available, BaudRate="9600")
eval = EvaluateCurve(Curve=reparameterize(crv), Parameter=random)  # -> Point, Tangent, Angle
end = EndPoints(Curve=crv)  # -> Start, End
panel_2 = Panel(read.SerialOutput)
panel_3 = Panel(read.StatusMessage)
panel_4 = Panel(open_port)
pt = Point(flatten([eval.Point, end.Start, end.End]))
pdecon = Deconstruct(Point=pt)  # -> XComponent, YComponent, ZComponent
sort = SortList(Keys=pdecon.ZComponent, ValuesA=pt)  # -> Keys, ValuesA
min = Minimum(A=read.SerialOutput, B=Slider(100, range=0..100))
pt_2 = Point(sort.ValuesA)
panel_5 = Panel(min)
shift = ShiftList(List=pt_2, Shift=1, Wrap=Toggle(False))
ln = Line(StartPoint=pt_2, EndPoint=shift)
crv_2 = Curve(<curve referenced from the Rhino model>)
dispatch = Dispatch(List=ln, DispatchPattern=[True, False])  # -> ListA, ListB
random_2 = Random(Range=Domain(0, 1), Number=min, Seed=Slider(60, range=0..100))
end_2 = EndPoints(Curve=dispatch.ListB)  # -> Start, End
end_3 = EndPoints(Curve=dispatch.ListA)  # -> Start, End
number_slider = Slider(90, range=0..100)
eval_2 = EvaluateCurve(Curve=reparameterize(crv_2), Parameter=random_2)  # -> Point, Tangent, Angle
end_4 = EndPoints(Curve=crv_2)  # -> Start, End
xz = XZPlane(Origin=end_2.Start)
xz_2 = XZPlane(Origin=end_3.Start)
neg = Negative(Value=number_slider)
pt_3 = Point(flatten([eval_2.Point, end_4.Start, end_4.End]))
rotate = Rotate(Geometry=dispatch.ListB, Angle=degrees(neg), Plane=xz)  # -> Geometry, Transform
rotate_2 = Rotate(Geometry=dispatch.ListA, Angle=degrees(number_slider), Plane=xz_2)  # -> Geometry, Transform
pdecon_2 = Deconstruct(Point=pt_3)  # -> XComponent, YComponent, ZComponent
sort_2 = SortList(Keys=pdecon_2.ZComponent, ValuesA=pt_3)  # -> Keys, ValuesA
weave = Weave(Pattern=[0, 1], Stream0=rotate_2.Geometry, Stream1=rotate.Geometry, NullGaps=False)
pt_4 = Point(sort_2.ValuesA)
end_5 = EndPoints(Curve=weave)  # -> Start, End
shift_2 = ShiftList(List=pt_4, Shift=1, Wrap=Toggle(False))
ln_2 = Line(StartPoint=pt_4, EndPoint=shift_2)
intcrv = Interpolate(Vertices=end_5.End, Degree=3, Periodic=Toggle(False), KnotStyle=1)  # -> Curve, Length, Domain
xy = XYPlane(Origin=Point(0, 0, 0))
Z = UnitZ(Factor=1)
dispatch_2 = Dispatch(List=ln_2, DispatchPattern=[True, False])  # -> ListA, ListB
line = LineSDL(Start=xy, Direction=Z, Length=1)
end_6 = EndPoints(Curve=dispatch_2.ListB)  # -> Start, End
end_7 = EndPoints(Curve=dispatch_2.ListA)  # -> Start, End
revsrf = Revolution(Curve=intcrv.Curve, Axis=line, Domain=Domain(0, 6.283185307))
number_slider_2 = Slider(90, range=0..100)
xz_3 = XZPlane(Origin=end_6.Start)
xz_4 = XZPlane(Origin=end_7.Start)
neg_2 = Negative(Value=number_slider_2)
rotate_3 = Rotate(Geometry=dispatch_2.ListB, Angle=degrees(neg_2), Plane=xz_3)  # -> Geometry, Transform
rotate_4 = Rotate(Geometry=dispatch_2.ListA, Angle=degrees(number_slider_2), Plane=xz_4)  # -> Geometry, Transform
weave_2 = Weave(Pattern=[0, 1], Stream0=rotate_4.Geometry, Stream1=rotate_3.Geometry, NullGaps=False)
end_8 = EndPoints(Curve=weave_2)  # -> Start, End
intcrv_2 = Interpolate(Vertices=end_8.End, Degree=3, Periodic=Toggle(False), KnotStyle=1)  # -> Curve, Length, Domain
xy_2 = XYPlane(Origin=Point(0, 0, 0))
Z_2 = UnitZ(Factor=1)
line_2 = LineSDL(Start=xy_2, Direction=Z_2, Length=1)
revsrf_2 = Revolution(Curve=intcrv_2.Curve, Axis=line_2, Domain=Domain(0, 6.283185307))
