# Grasshopper definition vaso.gh (Grasshopper 1.0.7)
# plug-ins: Firefly

ports_available = COMPortsAvailable()
toggle = BooleanToggle(True)  # disabled
panel = Panel("3")  # disabled
crv = Curve(<curve referenced from the Rhino model>)
timer = Timer(TimerInterval=1, Target=read)  # disabled
ports_available_2 = COMPortsAvailable()  # disabled
panel_2 = Panel(ports_available)
timer_2 = Timer(TimerInterval=1, Target=uno_read)  # disabled
timer_3 = Timer(TimerInterval=500, Target=read_2)
toggle_2 = BooleanToggle(False)  # disabled
panel_3 = Panel(ports_available_2)  # disabled
read = SerialReadGeneric(StartReadingValues=toggle, PortNumber=panel)  # -> SerialOutput, StatusMessage; disabled
random = Random(Range=Domain(0, 1), Number=Slider(30, range=0..100), Seed=Slider(60, range=0..100))
read_2 = SerialReadGeneric(StartReadingValues=Toggle(False), PortNumber="3")  # -> SerialOutput, StatusMessage
panel_4 = Panel("9600")  # disabled
uno_read = UnoRead(StartReadingValues=toggle_2, PortNumber=panel)  # -> AnalogPin0, AnalogPin1, AnalogPin2, AnalogPin3, AnalogPin4, AnalogPin5, DigitalPin2, DigitalPin4, DigitalPin7, StatusMessage; disabled
toggle_3 = BooleanToggle(True)  # disabled
open_port = OpenClosePort(OpenClosePort=Toggle(False), PortNumber=ports_available, BaudRate="9600")
panel_5 = Panel(read.StatusMessage)  # disabled
panel_6 = Panel(read.SerialOutput)  # disabled
apin1 = Panel(uno_read.AnalogPin0)  # disabled
eval = EvaluateCurve(Curve=reparameterize(crv), Parameter=random)  # -> Point, Tangent, Angle
apin1_2 = Panel(uno_read.StatusMessage)  # disabled
open_port_2 = OpenClosePort(OpenClosePort=toggle_3, PortNumber=ports_available_2, BaudRate=panel_4)  # disabled
end = EndPoints(Curve=crv)  # -> Start, End
panel_8 = Panel(read_2.SerialOutput)
panel_9 = Panel(read_2.StatusMessage)
panel_10 = Panel(open_port)
pt = Point(flatten([eval.Point, end.Start, end.End]))
panel_11 = Panel(open_port_2)  # disabled
pdecon = Deconstruct(Point=pt)  # -> XComponent, YComponent, ZComponent
sort = SortList(Keys=pdecon.ZComponent, ValuesA=pt)  # -> Keys, ValuesA
min = Minimum(A=read_2.SerialOutput, B=Slider(100, range=0..100))
pt_2 = Point(sort.ValuesA)
panel_12 = Panel(min)
shift = ShiftList(List=pt_2, Shift=1, Wrap=Toggle(False))
ln = Line(StartPoint=pt_2, EndPoint=shift)
dispatch = Dispatch(List=ln, DispatchPattern=[True, False])  # -> ListA, ListB
crv_2 = Curve(<curve referenced from the Rhino model>)
end_2 = EndPoints(Curve=ln)  # -> Start, End; disabled
number_slider = Slider(45, range=0..100)  # disabled
random_2 = Random(Range=Domain(0, 1), Number=min, Seed=Slider(60, range=0..100))
xz = XZPlane(Origin=end_2.Start)  # disabled
end_3 = EndPoints(Curve=dispatch.ListB)  # -> Start, End
end_4 = EndPoints(Curve=dispatch.ListA)  # -> Start, End
number_slider_2 = Slider(90, range=0..100)
xz_2 = XZPlane(Origin=end_3.Start)
xz_3 = XZPlane(Origin=end_4.Start)
rotate = Rotate(Geometry=ln, Angle=degrees(number_slider), Plane=xz)  # -> Geometry, Transform; disabled
eval_2 = EvaluateCurve(Curve=reparameterize(crv_2), Parameter=random_2)  # -> Point, Tangent, Angle
end_5 = EndPoints(Curve=crv_2)  # -> Start, End
neg = Negative(Value=number_slider_2)
rotate_2 = Rotate(Geometry=dispatch.ListB, Angle=degrees(neg), Plane=xz_2)  # -> Geometry, Transform
rotate_3 = Rotate(Geometry=dispatch.ListA, Angle=degrees(number_slider_2), Plane=xz_3)  # -> Geometry, Transform
pt_3 = Point(flatten([eval_2.Point, end_5.Start, end_5.End]))
pdecon_2 = Deconstruct(Point=pt_3)  # -> XComponent, YComponent, ZComponent
weave = Weave(Pattern=[0, 1], Stream0=rotate_3.Geometry, Stream1=rotate_2.Geometry, NullGaps=False)
sort_2 = SortList(Keys=pdecon_2.ZComponent, ValuesA=pt_3)  # -> Keys, ValuesA
end_6 = EndPoints(Curve=weave)  # -> Start, End
pt_4 = Point(sort_2.ValuesA)
shift_2 = ShiftList(List=pt_4, Shift=1, Wrap=Toggle(False))
intcrv = Interpolate(Vertices=end_6.End, Degree=3, Periodic=Toggle(False), KnotStyle=1)  # -> Curve, Length, Domain
ln_2 = Line(StartPoint=pt_4, EndPoint=shift_2)
xy = XYPlane(Origin=Point(0, 0, 0))
Z = UnitZ(Factor=1)
dispatch_2 = Dispatch(List=ln_2, DispatchPattern=[True, False])  # -> ListA, ListB
line = LineSDL(Start=xy, Direction=Z, Length=1)
revsrf = Revolution(Curve=intcrv.Curve, Axis=line, Domain=Domain(0, 6.283185307))
end_7 = EndPoints(Curve=dispatch_2.ListB)  # -> Start, End
end_8 = EndPoints(Curve=dispatch_2.ListA)  # -> Start, End
number_slider_3 = Slider(90, range=0..100)
xz_4 = XZPlane(Origin=end_7.Start)
xz_5 = XZPlane(Origin=end_8.Start)
neg_2 = Negative(Value=number_slider_3)
rotate_4 = Rotate(Geometry=dispatch_2.ListB, Angle=degrees(neg_2), Plane=xz_4)  # -> Geometry, Transform
rotate_5 = Rotate(Geometry=dispatch_2.ListA, Angle=degrees(number_slider_3), Plane=xz_5)  # -> Geometry, Transform
weave_2 = Weave(Pattern=[0, 1], Stream0=rotate_5.Geometry, Stream1=rotate_4.Geometry, NullGaps=False)
end_9 = EndPoints(Curve=weave_2)  # -> Start, End
intcrv_2 = Interpolate(Vertices=end_9.End, Degree=3, Periodic=Toggle(False), KnotStyle=1)  # -> Curve, Length, Domain
xy_2 = XYPlane(Origin=Point(0, 0, 0))
Z_2 = UnitZ(Factor=1)
line_2 = LineSDL(Start=xy_2, Direction=Z_2, Length=1)
revsrf_2 = Revolution(Curve=intcrv_2.Curve, Axis=line_2, Domain=Domain(0, 6.283185307))
