# Grasshopper definition iss_tracker.gh (Grasshopper 1.0.7)
# plug-ins: Swiftlet

trigger = Trigger(Interval=50, TimerInterval=50, Target=panel)
trigger_2 = Trigger(Interval=500, TimerInterval=500, Target=panel_2)  # disabled
panel = Panel("http://api.open-notify.org/iss-now.json")
panel_2 = Panel("http://192.168.4.2")
get = GETRequest(URL=panel)  # -> Status, Content, Response
get_2 = GETRequest(URL=panel_2)  # -> Status, Content, Response
fjs = FormatJsonString(JSONString=get.Content)
panel_3 = Panel(get.Status)
fjs_2 = FormatJsonString(JSONString=get_2.Content)
panel_4 = Panel(fjs)
panel_5 = Panel(fjs_2)
panel_6 = Panel(get_2.Status)
pjs = ParseJSONString(Text=panel_4)
pjs_2 = ParseJSONString(Text=panel_5)
gjok = GetJSONObjectKey(JObject=pjs, Key="iss_position")
gjok_2 = GetJSONObjectKey(JObject=pjs, Key="message")
gjok_3 = GetJSONObjectKey(JObject=pjs, Key="timestamp")
gjok_4 = GetJSONObjectKey(JObject=pjs_2, Key="start")
gjok_5 = GetJSONObjectKey(JObject=pjs_2, Key="online")
gjok_6 = GetJSONObjectKey(JObject=pjs_2, Key="active")
rjv = ReadJSONValue(JValue=gjok)  # -> AsString, AsNumber, AsBool
sjt = StringifyJSONToken(JToken=gjok_2)
sjt_2 = StringifyJSONToken(JToken=gjok_3)
rjv_2 = ReadJSONValue(JValue=gjok_4)  # -> AsString, AsNumber, AsBool
sjt_3 = StringifyJSONToken(JToken=gjok_5)
sjt_4 = StringifyJSONToken(JToken=gjok_6)
panel_7 = Panel(rjv_2.AsString)
panel_8 = Panel(sjt)
panel_9 = Panel(sjt_2)
panel_10 = Panel(rjv.AsString)
panel_11 = Panel(sjt_4)
rjo = ReadJSONObject(JObject=gjok_5)  # -> Keys, JTokens
panel_12 = Panel(rjo.Keys)
gjok_7 = GetJSONObjectKey(JObject=gjok, Key="latitude")
gjok_8 = GetJSONObjectKey(JObject=gjok, Key="longitude")
panel_13 = Panel(sjt_3)
sjt_5 = StringifyJSONToken(JToken=gjok_7)
sjt_6 = StringifyJSONToken(JToken=gjok_8)
panel_14 = Panel(sjt_5)
panel_15 = Panel(sjt_6)
xy = XYPlane(Origin=Point(0, 0, 0))
dom = ConstructDomain(DomainStart=Slider(-180, range=-180..180), DomainEnd=Slider(180, range=-180..180))
sph = Sphere(Base=xy, Radius=Slider(500, range=0..1000000))
remap = RemapNumbers(Value=panel_14, Source=dom, Target=Domain(0, 1))  # -> Mapped, Clipped
remap_2 = RemapNumbers(Value=panel_15, Source=dom, Target=Domain(0, 1))  # -> Mapped, Clipped
pt = ConstructPoint(XCoordinate=remap.Mapped, YCoordinate=remap_2.Mapped, ZCoordinate=0)
evalsrf = EvaluateSurface(Surface=reparameterize(sph), Point=pt)  # -> Point, Normal, UDirection, VDirection, Frame
amp = Amplitude(Vector=evalsrf.Normal, Amplitude=Slider(75, range=0..100))
move = Move(Geometry=evalsrf.Point, Motion=amp)  # -> Geometry, Transform
