# Grasshopper definition sensoresAPI.gh (Grasshopper 1.0.7)

panel = Panel("http://sensor.local/")
trigger = Trigger(Interval=100, TimerInterval=100, Target=panel)
enablebpm = BooleanToggle(False)
enabledist = BooleanToggle(False)
enableacc = BooleanToggle(False)
gate = StreamGate(Stream=panel, Gate=enableacc)  # -> Target0, Target1
gate_2 = StreamGate(Stream=panel, Gate=enablebpm)  # -> Target0, Target1
gate_3 = StreamGate(Stream=panel, Gate=enabledist)  # -> Target0, Target1
settext = SetText(url="http://sensor.local/", value="Boa noite")
accelerometer = Accelerometer(url=gate.Target1)  # -> success, accx, accy, accz, anglex, angley, anglez
bpm = BPM(url=gate_2.Target1)  # -> success, bpm, raw_heart_signal
distance = Distance(url=gate_3.Target1)  # -> success, distance
number_slider = Slider(9.791, range=0..50)
number_slider_2 = Slider(7.327, range=0..20)
Z = Slider(14.956, range=0..20)
panel_2 = Panel(distance.distance)
panel_3 = Panel(settext)
panel_4 = Panel(accelerometer.accy)
panel_5 = Panel(accelerometer.anglex)
panel_6 = Panel(accelerometer.angley)
panel_7 = Panel(accelerometer.anglez)
panel_8 = Panel(bpm.bpm)
panel_9 = Panel(bpm.raw_heart_signal)
panel_10 = Panel(accelerometer.accx)
panel_11 = Panel(accelerometer.accz)
zaxis = Zaxis(Z=Z, B=Z)
box = CenterBox(Base=PlaneXY(0, 0, 0), X=number_slider, Y=number_slider_2, Z=Z)
yaxis = Yaxis(Y=number_slider_2, B=number_slider_2)
twist = Twist(Geometry=box, Axis=zaxis, Angle=degrees(panel_5), Infinite=False, Rigid=False)
twist_2 = Twist(Geometry=twist, Axis=yaxis, Angle=degrees(panel_6), Infinite=False, Rigid=False)
xaxis = Xaxis(X=number_slider, B=number_slider)
twist_3 = Twist(Geometry=twist_2, Axis=xaxis, Angle=degrees(panel_7), Infinite=False, Rigid=False)
preview = CustomPreview(
    Geometry=twist_3,
    Material={diffuse=RGB(221, 160, 221), emission=RGB(66, 48, 66), shine=0.5, specular=RGB(255, 255, 255), transparency=0})

# ==== cluster Accelerometer
url = ClusterInput()  # URL from sensor server
concat = Concatenate(FragmentA=url, FragmentB="getAcc")
get = GETRequest(URL=concat)  # -> Status, Content, Response
panel = Panel(get.Content)
equals = Equality(FirstNumber="200", SecondNumber=get.Status)  # -> Equality, Inequality
equals_2 = Equality(FirstNumber="200")  # -> Equality, Inequality
equals_3 = Equality(FirstNumber="200")  # -> Equality, Inequality
and = GateAnd(A=equals.Equality, C=equals_2.Equality, B=equals_3.Equality)
pjs = ParseJSONString(Text=panel)
success = ClusterOutput(and)  # If request return success set it to true
gjok = GetJSONObjectKey(JObject=pjs, Key="acceleration")
gjok_2 = GetJSONObjectKey(JObject=pjs, Key="angle")
gjok_3 = GetJSONObjectKey(JObject=gjok, Key="x")
gjok_4 = GetJSONObjectKey(JObject=gjok, Key="y")
gjok_5 = GetJSONObjectKey(JObject=gjok, Key="z")
gjok_6 = GetJSONObjectKey(JObject=gjok_2, Key="x")
gjok_7 = GetJSONObjectKey(JObject=gjok_2, Key="y")
gjok_8 = GetJSONObjectKey(JObject=gjok_2, Key="z")
rjv = ReadJSONValue(JValue=gjok_3)  # -> AsString, AsNumber, AsBool
rjv_2 = ReadJSONValue(JValue=gjok_4)  # -> AsString, AsNumber, AsBool
rjv_3 = ReadJSONValue(JValue=gjok_5)  # -> AsString, AsNumber, AsBool
rjv_4 = ReadJSONValue(JValue=gjok_6)  # -> AsString, AsNumber, AsBool
rjv_5 = ReadJSONValue(JValue=gjok_7)  # -> AsString, AsNumber, AsBool
rjv_6 = ReadJSONValue(JValue=gjok_8)  # -> AsString, AsNumber, AsBool
accx = ClusterOutput(rjv.AsNumber)  # Get acceleration variations on X axis
accy = ClusterOutput(rjv_2.AsNumber)  # Get acceleration variations on Y axis
accz = ClusterOutput(rjv_3.AsNumber)  # Get acceleration variations on Z axis
anglex = ClusterOutput(rjv_4.AsNumber)  # Get angular position on X axis
angley = ClusterOutput(rjv_5.AsNumber)  # Get angular position on X axis
anglez = ClusterOutput(rjv_6.AsNumber)  # Get angular position on X axis

# ==== cluster SetText
value = ClusterInput()
cjv = CreateJSONValue(Value=value)
cjo = CreateJSONObject(Keys="text", Values=cjv)
url = ClusterInput()
sjt = StringifyJSONToken(JToken=cjo)
concat = Concatenate(FragmentA=url, FragmentB="setText")
ctb = CreateTextBody(Content=sjt, IsHtmlChecked=False, IsJavascriptChecked=False, IsJsonChecked=True, IsTextChecked=False, IsXmlChecked=False)
post = POSTRequest(URL=concat, Body=ctb)  # -> Status, Content, Response
equals = Equality(FirstNumber=post.Status, SecondNumber="200")  # -> Equality, Inequality
success = ClusterOutput(equals.Equality)  # Return true if request success

# ==== cluster Zaxis
B = ClusterInput()
subtraction = Subtraction(A=0, B=B)
Z = ClusterInput()
pt = ConstructPoint(XCoordinate=0, YCoordinate=0, ZCoordinate=subtraction)
pt_2 = ConstructPoint(XCoordinate=0, YCoordinate=0, ZCoordinate=Z)
ln = Line(StartPoint=pt_2, EndPoint=pt)
L = ClusterOutput(ln)

# ==== cluster Yaxis
B = ClusterInput()
subtraction = Subtraction(A=0, B=B)
Y = ClusterInput()
pt = ConstructPoint(XCoordinate=0, YCoordinate=subtraction, ZCoordinate=0)
pt_2 = ConstructPoint(XCoordinate=0, YCoordinate=Y, ZCoordinate=0)
ln = Line(StartPoint=pt_2, EndPoint=pt)
L = ClusterOutput(ln)

# ==== cluster Xaxis
B = ClusterInput()
subtraction = Subtraction(A=0, B=B)
X = ClusterInput()
pt = ConstructPoint(XCoordinate=subtraction, YCoordinate=0, ZCoordinate=0)
pt_2 = ConstructPoint(XCoordinate=X, YCoordinate=0, ZCoordinate=0)
ln = Line(StartPoint=pt_2, EndPoint=pt)
L = ClusterOutput(ln)

# ==== cluster BPM
url = ClusterInput()  # Server URL
concat = Concatenate(FragmentA=url, FragmentB="getBpm")
get = GETRequest(URL=concat)  # -> Status, Content, Response
equals = Equality(FirstNumber="200", SecondNumber=get.Status)  # -> Equality, Inequality
panel = Panel(get.Content)
success = ClusterOutput(equals.Equality)  # Return true if request success
pjs = ParseJSONString(Text=panel)
gjok = GetJSONObjectKey(JObject=pjs, Key="heartrate")
gjok_2 = GetJSONObjectKey(JObject=gjok, Key="bpm")
gjok_3 = GetJSONObjectKey(JObject=gjok, Key="raw")
rjv = ReadJSONValue(JValue=gjok_2)  # -> AsString, AsNumber, AsBool
rjv_2 = ReadJSONValue(JValue=gjok_3)  # -> AsString, AsNumber, AsBool
raw_heart_signal = ClusterOutput(rjv_2.AsNumber)  # Get raw heart pulse signal
bpm = ClusterOutput(rjv.AsNumber)  # Get bpm data from request

# ==== cluster Distance
url = ClusterInput()  # Server URL
concat = Concatenate(FragmentA=url, FragmentB="getDist")
get = GETRequest(URL=concat)  # -> Status, Content, Response
panel = Panel(get.Content)
equals = Equality(FirstNumber="200", SecondNumber=get.Status)  # -> Equality, Inequality
success = ClusterOutput(equals.Equality)  # Return true if request success
pjs = ParseJSONString(Text=panel)
gjok = GetJSONObjectKey(JObject=pjs, Key="distance")
gjok_2 = GetJSONObjectKey(JObject=gjok, Key="mm")
rjv = ReadJSONValue(JValue=gjok_2)  # -> AsString, AsNumber, AsBool
distance = ClusterOutput(rjv.AsNumber)  # Get distance from sensor in mm
